# Grasshopper definition rhinoinsideTestFIle.gh (Grasshopper 1.0.7)

radius = Slider(11, range=0..100)
num2 = Slider(0, range=0..100)
num1 = Slider(0, range=0..100)
xy = XYPlane(Origin=Point(0, 0, 0))
makesphere = CSharpScript(location=xy, radius=radius)  # -> out, StringOutput, result; inputs location: Plane, radius: Double
# ---------- makesphere: C# ----------
    Sphere sphere = new Sphere(location, radius);

    result = sphere;
    
    StringOutput = "something was here!";
# ---------- end makesphere ----------
addition = CSharpScript(num1=num1, num2=num2)  # -> out, result; inputs num1: Double, num2: Double
# ---------- addition: C# ----------
    result = num1 + num2;
# ---------- end addition ----------
result = Number(addition.result)
stringoutput = Text(makesphere.StringOutput)
resultsphere = Mesh(makesphere.result)
area = Area(Geometry=resultsphere)  # -> Area, Centroid
panel = Panel(area.Area)
